# Grasshopper definition testfile.gh (Grasshopper 1.0.8)
# plug-ins: ReactionDiffusion Info

# ---- group: Presets
list = ValueList({"Stripes": "0.0545,0.062", "Dots": "0.0367,0.0649", "Coral": "0.029,0.057", "Worms": "0.035,0.06"}, selected="Coral")
split = TextSplit(Text=list, Separators=",")
item = ListItem(List=split, Index=0, Wrap=True)  # -> Item, Item1

# ----
cellsxy = Slider(128, range=0..1000)
feed = Number(item.Item)
kill = Number(item.Item1)
reset = Button()
run = BooleanToggle(False)
reactiondiffusion = ReactionDiffusionComponent(
    Run=run,
    Reset=reset,
    CellsX=cellsxy,
    CellsY=cellsxy,
    DiffusionU=0.16,
    DiffusionV=0.08,
    FeedRate=feed,
    KillRate=kill,
    TimeStep=Slider(1, range=0..1),
    Steps=Slider(3000, range=0..10000),
    OutputSteps=Slider(50, range=0..100),
    Seed=1)  # -> U, V, CurrentStep
steps = Panel(reactiondiffusion.CurrentStep)
